# Requirement set Missile_Reqs (R2025b)

## 1 [RFP] Cost
Missile Cost will be less than $500,000

## 2 [RFP] Range
The range will be 500 nm from its launch to impact

## 3 [RFP] Cruise Speed
The missile must have a minimum cruise speed above Mach 3.

## 4 [RFP] Mark 41 VLS
Missile must be able to launch from Mark 41 VLS, Launch weight is less than 5000 lbm

## 5 [RFP] Land Based Launch (HIMARS)
The missile must be able to be launched from Mobile land-based launchers (ie, HIMRAS, MLRS). Launch weight < 2000 lbm.

## 6 [RFP] External Fighter
Missile must launch form an external fighter hard point. Launch weight < 2000 lbm.

## 7 [RFP] Submarine
Missile must launch from a submarine tube. Launch weight < 3500 lbm.

## 8 [RFP] Internal Fighter
Must launch from a figher internal carriage. Launch weight < 2000 lbm.

## 9 [RFP] Dimensions
Missile fits in a 15 x 15 x 144 in box.

## 10 [RFP] Warhead
Missile will have capability to neutralize a single target

## 11 [RFP] Data Links
Missile will have data link commands to include changes in-flight

## 12 [RFP] Safe Storage
Missile should be capable of safe storage up to 10 years without maintenance.

## 13 [RFP] Production Run
Initial production run will be 1200 missiles per year for 10 years w/ 100 for developmental testing

## 14 [RFP] Surge Production
Production should be surged up to 72 missiles per week (3744 missiles per year) within 1 week.

## 15 [RFP] Maintain Surge Production
Surge production should be sustained indefinetly at 72 units per week.

## 16 [RFP] Low-Level Ingress
Missile must have a low-level ingress to its target, traveling <= 500 ft AGL for the last 10% of its mission.

## 17 [RFP] Air Launch
Missile must be capable of air launch at Mach 0.8 at 30,000 ft.

## 18 [MIL-M-8856B] Factor Safety
Factor of safety will be a minimum of 1.5 for in-flight, storage, and transportation.

## 19 [MIL-M-8856B] Faliure under Ultimate Mission Load
The structure will not fail under the ultimate load condition outlined in the mission profile

## 20 [MIL-STD-1522A] Extreme Temp
Materials will be constructed based on extreme temperature cases seen during the mission profile

## 21 [MIL-M-8856B] Heating Effects
Missile design shall provide for the cummulative heating effect from internal and external heating

## 22 [MIL-M-8856B] Fatigue Life
The fatigue life of the structure will equal or exceed the specified life

## 23 [SMC-S-006]

## 24 [SMC-S-006]

## 25 [SMC-S-006]

## 26 [SMC-S-006]

## 27 [SMC-S-006]

## 28 [SMC-S-006]

## 29 [MIL-STD-1522A]

## 30 [MIL-STD-1901A]

## 31 [RTCA-DO-178]

## 32 [MIL-STD-1760]

## 33 [MIL-STD-704]

## 34 [MIL-STD-6016]

## 35 [MIL-STD-461]

## 36 [MIL-HDBK-781]

## 37 [RCTA-DO-160]

## 38 [MIL-STD-810]

## 39 [MIL-STD-882]